# Grasshopper definition example01_Single object.gh (Grasshopper 1.0.7)
# plug-ins: Animation

# ---- group: animation slider / slider for animation
# Use the slider to create animation frames.
number_slider = Slider(1, range=1..100)

# ---- group: camera
construct_point = ConstructPoint(XCoordinate=0, YCoordinate=0, ZCoordinate="30")
xy_plane = XYPlane(Origin=construct_point)
circle = Circle(Plane=xy_plane, Radius="80")
divide_curve = DivideCurve(Curve=circle, Count="100", Kinks=False)  # -> Points, Tangents, Parameters
list_item = ListItem(List=divide_curve.Points, Index=number_slider, Wrap=True)
construct_point_2 = ConstructPoint(XCoordinate=0, YCoordinate=0, ZCoordinate="10")
camera = Camera(Location=list_item, Target=construct_point_2, LensLength=50)
set_camera = SetCamera(On=Toggle(True), Camera=camera)

# ---- group: geometry
multiplication = Multiplication(A=number_slider, B=Slider(0.083, range=0..1))
construct_point_3 = ConstructPoint(XCoordinate=0, YCoordinate=0, ZCoordinate=0)
unit_z = UnitZ(Factor=multiplication)
center_box = CenterBox(Base=construct_point_3, X=multiplication, Y=multiplication, Z=multiplication)
move = Move(Geometry=center_box, Motion=unit_z)  # -> Geometry, Transform
brep = Brep(move.Geometry)

# ---- group: material
colour_hsv = ColourHSV(Alpha=1, Hue=expr("x/100.0", number_slider), Saturation=1, Value=1)
custom_material = CustomMaterial(
    DiffuseColor=colour_hsv,
    SpecularColor=RGB(255, 255, 255),
    ReflectionColor=RGB(255, 255, 255),
    Reflectivity="1",
    ReflectionGlossiness=0,
    UseFresnelReflection=Toggle(True),
    TransparentColor=RGB(255, 255, 255),
    Transparency=0,
    IndexOfRefraction=1,
    RefractionGlossiness=0,
    EmissionColor=RGB(0, 0, 0))

# ----
# Set True to save the animation frames.
boolean_toggle = BooleanToggle(False)
# Directory for saving the frames.
# Directory should make sense to avoid error.
file_path = FilePath("C:\Animation\")
panel = Panel(file_path)
animation = Animation(On=boolean_toggle, Geometry=brep, Material=custom_material, Directory=file_path)
