# Grasshopper definition example02_Multiple objects.gh (Grasshopper 1.0.7)
# plug-ins: Animation

# ---- group: slider for animation
# Use the slider to create animation frames.
number_slider = Slider(100, range=1..100)

# ----
construct_domain = ConstructDomain(DomainStart="-0.5", DomainEnd="0.5")

# ---- group: Camera
construct_point = ConstructPoint(XCoordinate=0, YCoordinate=0, ZCoordinate="30")
xy_plane = XYPlane(Origin=construct_point)
circle = Circle(Plane=xy_plane, Radius="80")
divide_curve = DivideCurve(Curve=circle, Count="200", Kinks=False)  # -> Points, Tangents, Parameters
list_item = ListItem(List=divide_curve.Points, Index=number_slider, Wrap=True)
construct_point_2 = ConstructPoint(XCoordinate=0, YCoordinate=0, ZCoordinate="0")
camera = Camera(Location=list_item, Target=construct_point_2, LensLength=50)
set_camera = SetCamera(On=Toggle(True), Camera=camera)

# ----
random = Random(Range=construct_domain, Number=number_slider, Seed=7)
random_2 = Random(Range=construct_domain, Number=number_slider, Seed=2)
random_3 = Random(Range=construct_domain, Number=number_slider, Seed=0)

# ---- group: geometry
construct_point_3 = ConstructPoint(XCoordinate=expr("x*20", random), YCoordinate=expr("x*20", random_3), ZCoordinate=expr("x*20", random_2))
center_box = CenterBox(Base=construct_point_3, X=random, Y=random_3, Z=random_2)
brep = Brep(center_box)

# ---- group: material
addition = Addition(A=random, B=random_3, C=random_2)
sort_list = SortList(Keys=addition)  # -> Keys, ValuesValuesA
list_item_2 = ListItem(List=sort_list.Keys, Index=-1, Wrap=True)
division = Division(A=addition, B=list_item_2)
colour_hsv = ColourHSV(Alpha=1, Hue=division, Saturation=1, Value=1)
custom_material = CustomMaterial(
    DiffuseColor=colour_hsv,
    SpecularColor=RGB(255, 255, 255),
    ReflectionColor=RGB(255, 255, 255),
    Reflectivity="1",
    ReflectionGlossiness=0,
    UseFresnelReflection=Toggle(True),
    TransparentColor=RGB(255, 255, 255),
    Transparency=0,
    IndexOfRefraction=1,
    RefractionGlossiness=0,
    EmissionColor=RGB(0, 0, 0))

# ----
# Set True to save the animation frames.
boolean_toggle = BooleanToggle(False)
# Directory for saving the frames.
# Directory should make sense to avoid error.
file_path = FilePath("C:\Animation\")
panel = Panel(file_path)
animation = Animation(On=boolean_toggle, Geometry=brep, Material=custom_material, Directory=file_path)
