# Grasshopper definition example03_Animation+Kangaroo.gh (Grasshopper 1.0.7)
# plug-ins: Animation, Kangaroo2 Components

# ---- group: slider for animation
# Use the slider to create animation frames.
number_slider = Slider(50, range=0..50)

# ---- group: geometry
R = Region({Plane=PlaneXY(-6, -7, 0.7377762218), X=Domain(0, 23), Y=Domain(0, 30), Z=Domain(0, 37.52444756)})
pop3d = Populate3D(Region=R, Count=400, Seed=1)
brep = Brep(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)
Z = UnitZ(Factor=-0.01)
R_2 = Radius(1)
spc = SolidPointCollide(Points=pop3d, Solid=brep, Interior=False, Unidirectional=Toggle(True), Strength=1)
sc = SphereCollide(Points=pop3d, Radius=R_2, Strength=10)
load = Load(Point=pop3d, ForceVector=Z)
on = BooleanToggle(True)
ghpython_script = GhPythonScript(x=number_slider)  # -> out, a
# ---------- ghpython_script: Python ----------
a = 3
# ---------- end ghpython_script ----------
stepsolver = StepSolver(GoalObjects=[sc, load, spc], Tolerance=0.01, Momentum=False, Damping=0.99, SubIterations=ghpython_script.a, Animate=on)  # -> I, V, O
mesh_sphere = MeshSphere(Base=stepsolver.V, Radius=R_2, UCount=10, VCount=20)

# ---- group: material
deconstruct = Deconstruct(Point=stepsolver.V)  # -> XComponent, YComponent, ZComponent
addition = Addition(A=deconstruct.ZComponent, B="13.0")
division = Division(A=addition, B="60.0")
colour_hsv = ColourHSV(Alpha=1, Hue=division, Saturation=1, Value=1)
custom_material = CustomMaterial(
    DiffuseColor=colour_hsv,
    SpecularColor=RGB(255, 255, 255),
    ReflectionColor=reverse(RGB(255, 255, 255)),
    Reflectivity="1",
    ReflectionGlossiness=0,
    UseFresnelReflection=Toggle(True),
    TransparentColor=RGB(255, 255, 255),
    Transparency=0,
    IndexOfRefraction=1,
    RefractionGlossiness=0,
    EmissionColor=RGB(0, 0, 0))
default_material = DefaultMaterial(Color=ColourSwatch(SwatchColor=RGB(255, 255, 255)))

# ---- group: camera
ghpython_script_2 = GhPythonScript(x=number_slider, y="50")  # -> out, a
# ---------- ghpython_script_2: Python ----------
a = 90 * 2 ** ( x / y)
# ---------- end ghpython_script_2 ----------
panel = Panel(ghpython_script_2.a)
point = Point(Point(-365.7928793, 225.22597, 491.7494376))
point_2 = Point(Point(0, 0, 0))
camera = Camera(Location=point, Target=point_2, LensLength=panel)
apply_camera = ApplyCamera(On=Toggle(True), Camera=camera)

# ----
# Set True to save the animation frames.
boolean_toggle = BooleanToggle(True)
# Directory for saving the frames.
# Directory should make sense to avoid error.
file_path = FilePath("C:\Animation\")
panel_2 = Panel(file_path)
animation = Animation(
    On=boolean_toggle,
    Geometry=flatten([mesh_sphere, brep]),
    Material=flatten([custom_material, default_material]),
    Directory=file_path)
